# Grasshopper definition real3Dtests.gh (Grasshopper 1.0.7)

ghpython_script = GhPythonScript()  # -> out, a
# ---------- ghpython_script: Python ----------
__author__ = "blairsubbaraman"

import math
import rhinoscriptsyntax as rs

# deal with inputs
if numPoints is None:
    numPoints = 360  
if r is None:
    r = 30
if f is None:
    f = 2

points = []

z=0
for i in range(int(numPoints)):
    t = math.radians(i)
    x = r * math.cos(2*math.pi*t)
    y = r * math.sin(2*math.pi*t)
    pt = (x,y,z)
    id = rs.AddPoint(pt)
    points.append(id)
    
    z+=0.5

helix = rs.AddInterpCurve(points)

if helix:
    domain = rs.CurveDomain(helix)
    piped_helix = rs.AddPipe(helix,0,0.4)

a = piped_helix
#    x = math.cos(n_x*t + phi_x)
#    y = math.cos(n_y*t + phi_y)
#    z = math.cos(n_z*t)
#    pt = (scaleFactor* x,scaleFactor*y,scaleFactor*z)
 #   id = rs.AddPoint(pt)
 #   points.append(id)

#points.append(points[-1])
#knot = rs.AddInterpCurve(points, knotstyle=3)

#if knot:
#    domain = rs.CurveDomain(knot)
 #   piped_knot = rs.AddPipe(knot,0,thickness)

#a = knot
# ---------- end ghpython_script ----------
ghpython_script_2 = GhPythonScript(Apply=Toggle(True))  # -> out, a
# ---------- ghpython_script_2: Python ----------
__author__ = "blairsubbaraman"

import rhinoscriptsyntax as rs
from datetime import datetime
import math as math
import sys
print(sys.version)

if layerHeight is None:
    layerHeight = 0.2 #mm
if filePath is None:
    filePath = "/Users/blairsubbaraman/Desktop/test-gcode.gcode"
if bedTemp is None:
    bedTemp = 0
if nozzleTemp is None:
    nozzleTemp = 200

def makeGcodeInfo(sb, p):
    sb.append("; " + datetime.now().strftime("%y%m%d_%H%M%S") + "\n")
    sb.append("; layerHeight : " + layerHeight + "\n")


def makeGcodeHeatSettings(sb):
    sb.append("M140 S" + str(bedTemp) +" ; Set Bed Temperature\n")
    sb.append("M105\n")
    sb.append("M190 S" + str(bedTemp) +" ; Wait for Bed Temperature\n")
    sb.append("M104 S" + str(nozzleTemp) +" ; Set Nozzle Temperature\n")
    sb.append("M105\n")
    sb.append("M109 S" + str(nozzleTemp) +" ; Wait for Nozzle Temperature\n")
    
# 
def makeGcodeStartupSettings(sb):
    #unit mm
    sb.append("G21\n")
    #autohome
    sb.append("G28\n")
    #set E to relative positioning
    sb.append("M83\n")
    #set interpreter to absolute positioning
    sb.append("G90\n")
    # liner move: straight line on the planner
    # feedrate: 300 to all following moves
    # then move in Z: 0.4 mm
    sb.append("G1 Z2.0 F300 ; Move Z Axis up little to prevent scratching of Heat Bed \n")
    sb.append("G1 X0.1 Y20 Z0.3 F5000.0 ; Move to start position \n")
    sb.append("G1 X0.1 Y200.0 Z0.3 F1500.0 E15 ; Draw the first line \n")
    sb.append("G1 X0.4 Y200.0 Z0.3 F5000.0 ; Move to side a little \n")
    sb.append("G1 X0.4 Y20 Z0.3 F1500.0 E30 ; Draw the second line \n")
    sb.append("G1 Z2.0 F3000 ; Move Z Axis up little to prevent scratching of Heat Bed \n")
    sb.append("G1 X5 Y20 Z0.3 F5000.0 ; Move over to prevent blob squish \n")
    sb.append("G92 E0 ; Set position \n")
    

def WriteFile(str, path):
    # open file and write to it
    f = open(path, "w")
    f.write(str)
    f.close()
    
def makeRetraction(amount, speed, sign):
    mes = "";
    if(sign == -1):
        mes = " ; Retraction"
    else:
        mes = " ; Extraction"
    #move with feedrate F, extract E finlament
    return "G1 F" + str(speed) + " E" + str(sign * amount) + mes + "\n"

def makeGcode(to):
    return "G0 F9000 X" + "{:.{}f}".format(to.X,2) + " Y" + "{:.{}f}".format(to.Y,2) + "\n" 

def makeE(previous, next):
    dx = next[0] - previous[0]
    dy = next[1] - previous[1]
    dz = next[2] - previous[2]
    d = math.sqrt(dx**2 + dy**2 + dz**2)
    e = (math.pow(_NozzleWidth/2, 2) * d) / math.pow(1.75/2, 2)
    #e = (_NozzleWidth * _LayerHeight * dist) / math.pow(1.75/2, 2)
    return e


#components  
_LayerHeight = layerHeight;
_NozzleWidth = 0.4;
_RetAmount = 10.0;
_RetSpeed = 1200;
PrintSpeed = 500;
PrintSpeedHigh = 1000; 

if(Apply == True):
    sb = []
    #makeGcodeInfo(sb, ParameterInfo)
    makeGcodeHeatSettings(sb)
    makeGcodeStartupSettings(sb)
    
    ## move to center
    sb.append("G0 Z10 \n")
    sb.append("G0 X100 Y100 \n")
    sb.append("G0 Z0.3 \n")
    sb.append("G92 X0 Y0 Z0 E0 ;this is now the origin \n")
    
    ## first make the points
    zHeight = 0.0
    r = 15
    f = 2
    points = []
    for i in range(3600):
        t = math.radians(i)
        x = r * math.cos(2*math.pi*t)
        y = r * math.sin(2*math.pi*t)
        pt = (x,y,zHeight)
        points.append(pt)
        zHeight += 0.5
    
    #now write gcode for the points
    sb.append("G0 X{:.2f}".format(points[0][0]) + " Y{:.2f}".format(points[0][1]) + " Z{:.2f}".format(points[0][2]) + " F25 \n"  )
    for i in range(len(points)-1):
        e = 20*float(makeE(points[i], points[i+1]))
        sb.append("G1 X{:.2f}".format(points[i+1][0])+" Y{:.2f}".format(points[i+1][1])+" Z{:.2f}".format(points[i+1][2]) + " E"+"{:.2f}".format(e) + "\n") #add all the extrusion moves
    #...maybe i'm done here?
    
    
    # disable steppers
    sb.append("M84");
    strsb = ''.join(sb)
    WriteFile(strsb, filePath);  
        
        
    a = strsb
# ---------- end ghpython_script_2 ----------
panel = Panel(ghpython_script_2.a)
panel_2 = Panel(ghpython_script_2.out)
